% Simulink data dictionary sstv_transmit.sldd

sstvTxTiming = Simulink.Bus()
  unit: uint16[4800 1]
  elapsed: double[4800 1]
  duration: double[4800 1]
  component: uint8[4800 1]
  tone: double[4800 1]
  valid: uint16
  finished: boolean
  width: double
  rowsPerUnit: double
  color: uint8
  pair: boolean

sstvTxAddress = Simulink.Bus()
  row: uint16[4800 1]
  column: uint16[4800 1]
  other: uint16[4800 1]
  component: uint8[4800 1]
  color: uint8
  pair: boolean

sstvTxPixels = Simulink.Bus()
  rgb: double[4800 3]
  otherRGB: double[4800 3]
  component: uint8[4800 1]
  color: uint8
  pair: boolean

sstvTxEncoded = Simulink.Bus()
  value: double[4800 1]
  other: double[4800 1]
  average: boolean[4800 1]